# Grasshopper definition color_test.gh (Grasshopper 1.0.7)

series = Series(Start="1", Step=1, Count="3")
dom = ConstructDomain(DomainStart=series, DomainEnd=expr("-x", series))
rectangle = Rectangle(Plane=PlaneXY(0, 0, 0), XSize=dom, YSize=dom, Radius=0)  # -> Rectangle, Length
item = ListItem(List=rectangle.Rectangle, Index=0, Wrap=True)  # -> Item, Item1, Item2
rh_out_rectangles = Curve(item.Item1)
rh_out_rectangles_2 = Curve(item.Item2)
rh_out_rectangles_3 = Curve(item.Item)
context_bake = ContextBake(Geometry=rh_out_rectangles_3)
context_bake_2 = ContextBake(Geometry=rh_out_rectangles)
context_bake_3 = ContextBake(Geometry=rh_out_rectangles_2)
