# Grasshopper definition hotdogjpeg.gh (Grasshopper 1.0.7)

length = Slider(5, range=0..10)
radius = Slider(1, range=0..10)
rise = Slider(0.5, range=0..2)
radius_2 = GetNumber(radius, AtLeast=1, AtMost=1, Maximum=1.797693135e+308, Minimum=-1.797693135e+308, TreeAccess=False)
rise_2 = GetNumber(rise, AtLeast=1, AtMost=1, Maximum=1.797693135e+308, Minimum=-1.797693135e+308, TreeAccess=False)
length_2 = GetNumber(length, AtLeast=1, AtMost=1, Maximum=1.797693135e+308, Minimum=-1.797693135e+308, TreeAccess=False)
boolean = GetNumber(Slider(1, range=0..1), AtLeast=1, AtMost=1, Maximum=1.797693135e+308, Minimum=-1.797693135e+308, TreeAccess=False)
max = Maximum(A=length_2, B="4")
max_2 = Maximum(A=rise_2, B="0")
max_3 = Maximum(A=radius_2, B="0.7")
min = Minimum(A=max, B="10")
min_2 = Minimum(A=max_2, B="1.2")
min_3 = Minimum(A=max_3, B="1.2")
division = Division(A=min, B=3)
multiplication = Multiplication(A=division, B=min_2)
# Sausage
X = UnitX(Factor=min)
Z = UnitZ(Factor=multiplication)
pt = ConstructPoint(XCoordinate=0, YCoordinate=0, ZCoordinate=min_3)
rev = Reverse(Vector=X)
move = Move(Geometry=pt, Motion=X)  # -> Geometry, Transform
move_2 = Move(Geometry=pt, Motion=rev)  # -> Geometry, Transform
move_3 = Move(Geometry=move.Geometry, Motion=Z)  # -> Geometry, Transform
move_4 = Move(Geometry=move_2.Geometry, Motion=Z)  # -> Geometry, Transform
minmax_sauce_from_mid = Panel("0.3 to 0.8")
minmax_sauce_from_mid_2 = Panel("0.4 to 0.7")
_0_5_of_twists_sauce = Panel("3")
arc = Arc3Pt(PointA=move_3.Geometry, PointB=pt, PointC=move_4.Geometry)  # -> Arc, Plane, Radius
range = Range(Domain=minmax_sauce_from_mid, Steps=_0_5_of_twists_sauce)
range_2 = Range(Domain=minmax_sauce_from_mid_2, Steps=_0_5_of_twists_sauce)
pipe = Pipe(Curve=arc.Arc, Radius=min_3, Caps=2)
twists_sauce = Panel("7")
jitter = Jitter(List=range, Jitter=1, Seed=2)  # -> Values, Indices
jitter_2 = Jitter(List=range_2, Jitter=1, Seed="5")  # -> Values, Indices
divide = DivideCurve(Curve=arc.Arc, Count=twists_sauce, Kinks=False)  # -> Points, Tangents, Parameters
alternatepts = Panel("""0
1""")
multiplication_2 = Multiplication(A=min_3, B=jitter_2.Values)
multiplication_3 = Multiplication(A=min_3, B=jitter.Values)
dispatch = Dispatch(List=divide.Points, DispatchPattern=alternatepts)  # -> ListA, ListB
Y = UnitY(Factor=multiplication_2)
Y_2 = UnitY(Factor=multiplication_3)
rev_2 = Reverse(Vector=Y)
rev_3 = Reverse(Vector=Y_2)
move_5 = Move(Geometry=dispatch.ListA, Motion=Y)  # -> Geometry, Transform
move_6 = Move(Geometry=dispatch.ListB, Motion=rev_2)  # -> Geometry, Transform
move_7 = Move(Geometry=dispatch.ListA, Motion=rev_3)  # -> Geometry, Transform
move_8 = Move(Geometry=dispatch.ListB, Motion=Y_2)  # -> Geometry, Transform
weave = Weave(Pattern=[0, 1], Stream0=move_6.Geometry, Stream1=move_5.Geometry, NullGaps=False)
weave_2 = Weave(Pattern=[0, 1], Stream0=move_8.Geometry, Stream1=move_7.Geometry, NullGaps=False)
trim_sauce_from_end = Panel("-.1")
intcrv = Interpolate(Vertices=weave, Degree=3, Periodic=False, KnotStyle=1)  # -> Curve, Length, Domain
intcrv_2 = Interpolate(Vertices=weave_2, Degree=3, Periodic=False, KnotStyle=1)  # -> Curve, Length, Domain
# Sauce
ext = ExtendCurve(Curve=intcrv.Curve, Type=0, Start=trim_sauce_from_end, End="-.5")
custom_mesh_settings = SettingsCustom(
    StitchSeams=False,
    SimplePlanes=False,
    Refine=False,
    MinCount=16,
    MaxCount=400,
    AspectRatio="10",
    MaxDistance=0,
    MaxAngle=Slider(50, range=0..100),
    MinEdge=0,
    MaxEdge=0)
ext_2 = ExtendCurve(Curve=intcrv_2.Curve, Type=0, Start="-2.5", End=trim_sauce_from_end)
custom_mesh_settings_2 = SettingsCustom(
    StitchSeams=False,
    SimplePlanes=False,
    Refine=False,
    MinCount=16,
    MaxCount=400,
    AspectRatio=20,
    MaxDistance=0,
    MaxAngle=Slider(15, range=0..100),
    MinEdge=0,
    MaxEdge=0)
project = Project(Curve=ext, Brep=pipe, Direction=Vector(0, 0, 1))
project_2 = Project(Curve=ext_2, Brep=pipe, Direction=Vector(0, 0, 1))
end = EndPoints(Curve=project_2)  # -> Start, End
end_2 = EndPoints(Curve=project)  # -> Start, End
pdecon = Deconstruct(Point=end.Start)  # -> XComponent, YComponent, ZComponent
pdecon_2 = Deconstruct(Point=end_2.Start)  # -> XComponent, YComponent, ZComponent
mesh = MeshBrep(Brep=pipe, Settings=custom_mesh_settings_2)
item = ListItem(List=pdecon.ZComponent, Index=0, Wrap=True)  # -> Item, Item1
item_2 = ListItem(List=pdecon_2.ZComponent, Index=0, Wrap=True)  # -> Item, Item1
max_4 = Maximum(A=item.Item, B=item.Item1)
max_5 = Maximum(A=item_2.Item, B=item_2.Item1)
mesh_2 = Mesh([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])
mesh_3 = Mesh(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)
mesh_4 = Mesh([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])
equals = Equality(FirstNumber=pdecon.ZComponent, SecondNumber=max_4)  # -> Equality, Inequality
equals_2 = Equality(FirstNumber=pdecon_2.ZComponent, SecondNumber=max_5)  # -> Equality, Inequality
medges = MeshEdges(Mesh=mesh)  # -> NakedEdges, InteriorEdges, NonManifoldEdges
medges_2 = MeshEdges(Mesh=mesh_3)  # -> NakedEdges, InteriorEdges, NonManifoldEdges
medges_3 = MeshEdges(Mesh=mesh_2)  # -> NakedEdges, InteriorEdges, NonManifoldEdges
medges_4 = MeshEdges(Mesh=mesh_4)  # -> NakedEdges, InteriorEdges, NonManifoldEdges
dispatch_2 = Dispatch(List=project_2, DispatchPattern=equals.Equality)  # -> ListA, ListB
dispatch_3 = Dispatch(List=project, DispatchPattern=equals_2.Equality)  # -> ListA, ListB
sauce_thickness = Panel("0.15")
crv = Curve([medges.InteriorEdges, medges.NonManifoldEdges, medges.NakedEdges])
crv_2 = Curve([medges_2.InteriorEdges, medges_2.NonManifoldEdges, medges_2.NakedEdges])
crv_3 = Curve([medges_3.InteriorEdges, medges_3.NonManifoldEdges, medges_3.NakedEdges])
crv_4 = Curve([medges_4.InteriorEdges, medges_4.NonManifoldEdges, medges_4.NakedEdges])
addition = Addition(A=sauce_thickness, B=0.02)
pipe_2 = Pipe(Curve=dispatch_3.ListA, Radius=sauce_thickness, Caps=2)
mesh_5 = MeshBrep(Brep=pipe_2, Settings=custom_mesh_settings)
medges_5 = MeshEdges(Mesh=mesh_5)  # -> NakedEdges, InteriorEdges, NonManifoldEdges
crv_5 = Curve([medges_5.InteriorEdges, medges_5.NonManifoldEdges, medges_5.NakedEdges])
pipe_3 = Pipe(Curve=dispatch_2.ListA, Radius=addition, Caps=2)
mesh_6 = MeshBrep(Brep=pipe_3, Settings=custom_mesh_settings)
medges_6 = MeshEdges(Mesh=mesh_6)  # -> NakedEdges, InteriorEdges, NonManifoldEdges
crv_6 = Curve([medges_6.InteriorEdges, medges_6.NonManifoldEdges, medges_6.NakedEdges])
# BunNapkin
swatch = ColourSwatch(SwatchColor=RGB(228, 171, 90))
# Sausage
panel = Panel("#af6042")
mesh_7 = Mesh(pipe_3)
mesh_8 = Mesh(pipe_2)
mesh_9 = Mesh(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)
mesh_10 = Mesh([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])
mesh_11 = Mesh([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])
mcol = MeshColours(Mesh=pipe, Colours=panel)
mcol_2 = MeshColours(Mesh=mesh_8, Colours="yellow")
mcol_3 = MeshColours(Mesh=mesh_7, Colours="red")
mcol_4 = MeshColours(Mesh=mesh_9, Colours=ColourSwatch(SwatchColor=RGB(255, 0, 53)))
mcol_5 = MeshColours(Mesh=mesh_10, Colours=swatch)
mcol_6 = MeshColours(Mesh=mesh_11, Colours="green")
merge = Merge(Data1=crv_5, Data2=crv_6, Data3=crv, Data4=crv_2, Data5=crv_3, Data6=crv_4)  # -> flatten(Result)
pt_2 = ConstructPoint(XCoordinate=0, YCoordinate=0, ZCoordinate=0)
curvepoint = PointOnCurve(merge, parameter=0.5)
# Curves
pull = PullPoint(Point=curvepoint, Geometry=pt_2, ClosestOnly=True)  # -> ClosestPoint, Distance
bnd = Bounds(Numbers=pull.Distance)
remap = RemapNumbers(Value=pull.Distance, Source=bnd, Target=Domain(0, 1))  # -> Mapped, Clipped
mjoin = MeshJoin(Meshes=flatten([mcol_3, mcol_2]))
mjoin_2 = MeshJoin(Meshes=flatten([mcol_3, mcol_2, mcol_4, mcol_5, mcol_6]))
gradient = Gradient(
    LowerLimit=0,
    UpperLimit=1,
    Parameter=remap.Mapped,
    stops=[0: RGB(255, 224, 192), 0.138: RGB(255, 192, 128), 0.317: RGB(255, 128, 0), 0.5: RGB(192, 64, 0), 0.75: RGB(128, 64, 0), 1: RGB(128, 64, 64)])
filter = StreamFilter(Gate=boolean, Stream0=mcol)
filter_2 = StreamFilter(Gate=boolean, Stream0=mjoin_2)
filter_3 = StreamFilter(Gate=boolean, Stream0=mjoin)
c_script = CSharpScript(crv=merge, color=gradient)  # -> out, A; inputs crv: Curve, color: Color
# ---------- c_script: C# ----------
    var c = color.R + "," + color.G + "," + color.B;
    crv.SetUserString("color", c);
    A = crv;
# ---------- end c_script ----------
curve = Curve(flatten(c_script.A))
filter_4 = StreamFilter(Gate=boolean, Stream1=curve)
context_bake = ContextBake(Geometry=filter)
context_bake_2 = ContextBake(Geometry=filter_3)
context_bake_3 = ContextBake(Geometry=filter_2)
context_bake_4 = ContextBake(Geometry=filter_4)
