# Grasshopper definition plane.gh (Grasshopper 1.0.7)

fly = GetNumber(Slider(0.45, range=0..1), AtLeast=1, AtMost=1, Maximum=1.797693135e+308, Minimum=-1.797693135e+308)
yz = YZPlane(Origin=Point(0, 0, 0))
multiplication = Multiplication(A=fly, B=3)
geo = Geometry(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)
rotate = Rotate(Geometry=yz, Angle=multiplication, Plane=PlaneXY(0, 0, 0))  # -> Geometry, Transform
area = Area(Geometry=geo)  # -> Area, Centroid
cir = Circle(Plane=rotate.Geometry, Radius=Slider(21, range=0..1000))
xz = XZPlane(Origin=area.Centroid)
prot = RotatePlane(Plane=xz, Angle=degrees("270"))
pframe = PerpFrame(Curve=reparameterize(cir), Parameter=fly)
orient = Orient(Geometry=geo, Source=prot, Target=pframe)  # -> Geometry, Transform

# ---- group: RH_OUT:plane
mesh = Mesh(orient.Geometry)
